# Grasshopper definition peak_load_example.gh (Grasshopper 1.0.7)

# ----
# Create Blended Building Programs
panel = Panel("""2013::Hospital::Corridor
2013::Hospital::Dining
2013::Hospital::Lobby
2013::Hospital::NurseStn
2013::Hospital::Office
2013::Hospital::PatRoom""")
panel_2 = Panel("""2013::FullServiceRestaurant::Dining
2013::FullServiceRestaurant::Kitchen""")
panel_3 = Panel("""2013::StripMall::Type 2
2013::FullServiceRestaurant::Dining
2013::FullServiceRestaurant::Kitchen
2013::SmallHotel::Corridor
2013::SmallHotel::GuestLounge
2013::SmallHotel::GuestRoom
2013::SmallHotel::Office""")
panel_4 = Panel("""2013::SmallOffice::ClosedOffice
2013::SmallOffice::Conference
2013::SmallOffice::Corridor
2013::SmallOffice::OpenOffice
2013::SmallOffice::Restroom
2013::SmallOffice::Storage""")
panel_5 = Panel("""2013::MidriseApartment::Apartment
2013::MidriseApartment::Corridor
2013::MidriseApartment::Office""")
panel_6 = Panel("""0.15
0.15
0.2
0.4
0.05
0.05""")
panel_7 = Panel("""0.6
0.35
0.05""")
panel_8 = Panel("""0.3
0.1
0.1
0.05
0.05
0.4""")
panel_9 = Panel("""0.8
0.2""")
panel_10 = Panel("""0.3
0.25
0.05
0.1
0.05
0.2
0.05""")
blendprograms = HBBlendProgramTypes(name="Residential Building", programs=panel_5, ratios=panel_7)  # -> program; plug-in component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
blendprograms_2 = HBBlendProgramTypes(name="Office Building", programs=panel_4, ratios=panel_6)  # -> program; plug-in component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
blendprograms_3 = HBBlendProgramTypes(name="Mixed Use Building", programs=panel_3, ratios=panel_10)  # -> program; plug-in component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
blendprograms_4 = HBBlendProgramTypes(name="Restaurant Building", programs=panel_2, ratios=panel_9)  # -> program; plug-in component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
blendprograms_5 = HBBlendProgramTypes(name="Hospital Building", programs=panel, ratios=panel_8)  # -> program; plug-in component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

# ----
# Basic Building Properties
building_names = Panel("""Mixed_use 1
Restaurant 1
Residential 1
Residential 2
Residential 4
Residential 5
Office 1
Hospital 1
Hospital 2
Mixed use 2
Residential 3
Mall 1
Residential 6""")
floor_to_floor_m = Panel("3.5")
number_of_stories = Panel("""4
1
3
3
1
1
6
10
3
8
3
3
10""")
footprints = Geometry(simplify(graft([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])))
perimeter_depth_m = Panel("10")
dup = DuplicateData(Data=floor_to_floor_m, Number=number_of_stories, Order=True)  # -> simplify(Data)
data = Data(simplify(graft(building_names)))

# ----
# Construction Set
bldg_vintage = Dragonfly_BldgAge({"ASHRAE 90.1 2013  |  IECC 2015": "2013", "ASHRAE 90.1 2010  |  IECC 2012": "2010", "ASHRAE 90.1 2007  |  IECC 2009": "2007", "ASHRAE 90.1 2004  |  IECC 2006": "2004", "1980-2004 (CBECS)": "1980_2004", "Pre-1980 (CBECS)": "pre_1980"}, selected="ASHRAE 90.1 2013  |  IECC 2015")
constr_type = Dragonfly_BldgAge({"SteelFramed", "WoodFramed", "Mass", "Metal Building"}, selected="SteelFramed")
climate_zone = Dragonfly_BldgAge({"1 - Very Hot": "1", "2 - Hot": "2", "3 - Warm": "3", "4 - Mixed": "4", "5 - Cool": "5", "6 - Cold": "6", "7 - Very Cold": "7", "8 - Subarctic": "8"}, selected="5 - Cool")
constrsetclimate = HBConstructionSetByClimate(climate_zone=climate_zone, vintage=bldg_vintage, constr_type=constr_type)  # -> constr_set; plug-in component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
data_2 = Data(constrsetclimate)

# ----
# Order Programs
# to Match Footprints
merge = Merge(
    Data1=blendprograms_3,
    Data2=blendprograms_4,
    Data3=blendprograms,
    Data4=blendprograms,
    Data5=blendprograms,
    Data6=blendprograms,
    Data7=blendprograms_2,
    Data8=blendprograms_5,
    Data9=blendprograms_5,
    Data10=blendprograms_3,
    Data11=blendprograms,
    Data12="2013::StripMall::Type 2",
    Data13=blendprograms)  # -> simplify(graft(Result))

# ----
# Create Buildings
buildingfootprint = DFBuildingFromFootprint(
    footprint_geo=footprints,
    floor_to_floor=dup,
    perim_offset=perimeter_depth_m,
    name=data,
    program=merge,
    constr_set=data_2,
    run=Toggle(True))  # -> report, buildings; plug-in component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
topbottom = DFSeparateTopBottom(buildings=buildingfootprint.buildings)  # -> simplify(buildings); plug-in component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

# ----
# Assign Windows
window_ratios_per_building = Panel("""0.2
0.35
0.3
0.3
0.3
0.3
0.7
0.6
0.6
0.35
0.3
0.25
0.4""")
simpleratiopar = DFSimpleWindowRatioParameters(ratio=window_ratios_per_building)  # -> simplify(graft(win_par)); plug-in component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
applyfacadepar = DFApplyFacadeParameters(df_obj=topbottom, win_par=simpleratiopar)  # -> report, df_obj; plug-in component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

# ----
# Create Model
panel_11 = Panel("Buffalo New Development")
model = DFModel(buildings=flatten(applyfacadepar.df_obj), name=panel_11)  # -> report, model; plug-in component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

# ----
# Visualize Model Properties
data_3 = Data(flatten(model.model))
room2dattr = DFRoom2DAttributes({"Display Name": "display_name", "Simulation Name (Identifier)": "identifier", "Floor-To-Ceiling Height": "floor_to_ceiling_height", "Floor Elevation": "floor_height", "Ceiling Elevation": "ceiling_height", "Is Ground Contact": "is_ground_contact"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}, selected="Program": "properties.energy.program_type.display_name")
colorroom2dattr = DFColorRoom2DAttributes(df_obj=flatten(data_3), attribute=room2dattr)  # -> mesh, legend, wire_frame, values, colors; plug-in component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

# ----
# Download DDY File
panel_12 = Panel("https://www.energyplus.net/weather-download/north_and_central_america_wmo_region_4/USA/NY/USA_NY_Buffalo-Greater.Buffalo.Intl.AP.725280_TMY/all")
downloadepw = LBDownloadWeather(weather_URL=panel_12)  # -> epw_file, stat_file, ddy_file; plug-in component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

# ----
# Serialize to Honeybee
toggle = BooleanToggle(False)
tohoneybee = DFModelToHoneybee(model=model.model, obj_per_model="District", use_multiplier=toggle, run=Toggle(True))  # -> report, hb_models; plug-in component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
deconstructmodel = HBDeconstructModel(model=tohoneybee.hb_models)  # -> rooms, faces, apertures, doors, shades; plug-in component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

geo = Geometry(colorroom2dattr.wire_frame)

# ---- group: Run Me!
toggle_2 = BooleanToggle(False)

# ----
# Run Peak Loads
panel_13 = Panel("2")
gate = StreamGate(Stream=panel_13, Gate=toggle_2)  # -> Target0, Target1
peakloads = HBPeakLoads(rooms=deconstructmodel.rooms, ddy_file=downloadepw.ddy_file, run_bal=Toggle(True), run=gate.Target1)  # -> report, peak_cool, peak_heat, cooling, heating, cool_bal, heat_bal; plug-in component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

# ----
# Visualize Peak Cooling per Zone
panel_14 = Panel("25")
vizfloors = DFVizualizeFloors(df_objs=flatten(model.model))  # -> geo; plug-in component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
legendpar = LBLegendParameters(min="0", num_decimals="0", seg_height=panel_14, seg_width=panel_14)  # -> leg_par; plug-in component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
area = Area(Geometry=vizfloors)  # -> Area, Centroid
pt = Point(Point(553.9041034, 61.60684839, 0))
division = Division(A=peakloads.peak_cool, B=area.Area)
createlegend = LBCreateLegend(values=division, base_plane=pt, title="Peak Cooling (W/m2)", legend_par=legendpar)  # -> mesh, title_obj, label_objs, label_text, colors; plug-in component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
mspray = MeshSpray(Mesh=graft(vizfloors), Points="0,0", Colours=graft(createlegend.colors), SprayMode=11)

# ----
# Create Legend Parameters
panel_15 = Panel("9")
colrange = LBColorRange(index=panel_15)  # -> flatten(colors); plug-in component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
replace = ReplacePaths(Data=simplify(colrange), Search="{0}", Replace="{1}")
dup_2 = DuplicateData(Data=ColourSwatch(SwatchColor=RGB(37, 93, 153)), Number=2, Order=True)
legendpar_2 = LBLegendParameters(min="0", max="20000000", colors=[replace, dup_2], num_decimals="0")  # -> leg_par; plug-in component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

# ----
# Plot Loads Over the Day
panel_16 = Panel("""0,50,0
0,0,0""")
data_4 = Data(simplify(graft(panel_16)))
monthlychart = LBMonthlyChart(data=[peakloads.cool_bal, peakloads.cooling], base_pt=data_4, x_dim="40", stack=Toggle(True), legend_par=legendpar_2)  # -> report, data_mesh, data_lines, legend, borders, labels, y_title, title; plug-in component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
item = ListItem(List=flatten(monthlychart.legend), Index=[0, 1], Wrap=True)
medges = MeshEdges(Mesh=item)  # -> NakedEdges, InteriorEdges, NonManifoldEdges
