# Grasshopper definition single_family_energy_model.gh (Grasshopper 1.0.7)

# ----
# Setup Model
panel = Panel("2019::MidriseApartment::Apartment")
geo = Geometry([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])
geo_2 = Geometry(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)
aperture = HBAperture(geo=geo, operable=Toggle(True))  # -> report, apertures; plug-in component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
roomsolid = HBRoomFromSolid(geo=flatten(geo_2), name="Residence", constr_set="2004::ClimateZone3::SteelFramed", program=panel, conditioned=True)  # -> report, rooms; plug-in component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
bordershades = HBExtrudedBorderShades(hb_objs=flatten(aperture.apertures), depth="0.3")  # -> report, hb_objs; plug-in component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
geo_3 = Geometry([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])
addsubface = HBAddSubface(hb_obj=flatten(roomsolid.rooms), sub_faces=flatten(bordershades.hb_objs))  # -> report, hb_obj, unmatched; plug-in component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
shade = HBShade(geo=geo_3)  # -> report, shades; plug-in component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

# ----
# Request Outputs
toggle = BooleanToggle(True)
simoutput = HBSimulationOutput(zone_energy_use=toggle, gains_and_losses=toggle, surface_energy_flow=toggle)  # -> report, sim_output; plug-in component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
simpar = HBSimulationParameter(output=simoutput.sim_output, timestep="1")  # -> sim_par; plug-in component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

# ----
# Download EPW File
panel_2 = Panel("http://climate.onebuilding.org/WMO_Region_4_North_and_Central_America/USA_United_States_of_America/CA_California/USA_CA_Burbank-Hope.AP.722880_TMY3.zip")
downloadepw = LBDownloadWeather(weather_URL=panel_2)  # -> epw_file, stat_file, ddy_file; plug-in component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

house_shades = Data(flatten(shade.shades))
house_rooms = Data(flatten(addsubface.hb_obj))

# ----
# Create Model
panel_3 = Panel("single_family_home")
model = HBModel(rooms=flatten(house_rooms), name=panel_3)  # -> report, model; plug-in component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

toggle_2 = BooleanToggle(False)

# ----
# Visualize Model
vizbytype = HBVisualizeByType(hb_objs=model.model)  # -> walls, interior_walls, roofs, ceilings, exterior_floors, interior_floors, air_walls, apertures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; plug-in component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

modeltoosm = HBModelToOSM(model=model.model, epw_file=downloadepw.epw_file, sim_par=simpar, write=toggle_2, run=toggle_2)  # -> report, jsons, osw, osm, idf, sql, zsz, rdd, html; plug-in component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

# ----
# Compute EUI
eui = HBEndUseIntensity(sql=modeltoosm.sql)  # -> eui, eui_end_use, end_uses, gross_floor; plug-in component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
eui_kwh_m2 = Panel(eui.eui)
panel_4 = Panel(eui.eui_end_use)
panel_5 = Panel(eui.end_uses)

# ----
# Import
# Results
faceresult = HBReadFaceResult(sql=modeltoosm.sql)  # -> face_indoor_temp, face_outdoor_temp, face_energy_flow; plug-in component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
roomenergyresult = HBReadRoomEnergyResult(sql=modeltoosm.sql)  # -> cooling, heating, lighting, electric_equip, gas_equip, process, hot_water, fan_electric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; plug-in component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

data = Data(model.model)

# ----
# Construct Energy Balance
toggle_3 = BooleanToggle(False)
loadbalance = HBThermalLoadBalance(
    rooms_model=flatten(data),
    cooling=roomenergyresult.cooling,
    heating=roomenergyresult.heating,
    lighting=roomenergyresult.lighting,
    electric_equip=roomenergyresult.electric_equip,
    hot_water=roomenergyresult.hot_water,
    people_gain=roomenergyresult.people_gain,
    solar_gain=roomenergyresult.solar_gain,
    infiltration_load=roomenergyresult.infiltration_load,
    mech_vent_load=roomenergyresult.mech_vent_load,
    face_energy_flow=faceresult.face_energy_flow,
    detailed_faces=toggle_3)  # -> report, balance, balance_stor, norm_bal, norm_bal_stor; plug-in component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
timeop = LBTimeIntervalOperation(data=loadbalance.norm_bal_stor)  # -> daily, monthly, mon_per_hr; plug-in component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
colrange = LBColorRange(index="19")  # -> colors; plug-in component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
legendpar = LBLegendParameters(colors=colrange, num_decimals="1", text_height="1.5")  # -> leg_par; plug-in component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
monthlychart = LBMonthlyChart(data=timeop.monthly, base_pt="-200, 0, 0", y_dim="60", stack=Toggle(True), legend_par=legendpar)  # -> report, data_mesh, data_lines, col_lines, legend, borders, labels, y_title, title, vis_set; plug-in component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

# ----
# Plot Results
panel_6 = Panel("50, 0, 0")
hourlyplot = LBHourlyPlot(data=roomenergyresult.hot_water, base_pt=panel_6)  # -> report, mesh, legend, borders, labels, title, vis_set; plug-in component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
