# Grasshopper definition annual_daylight.gh (Grasshopper 1.0.7)

# ---- group: Opaque Faces
geo = Geometry([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])
roomsolid = HBRoomFromSolid(geo=flatten(geo), name="TestRoom", conditioned=True)  # -> report, rooms; plug-in component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

# ---- group: Apertures
# Geometry Preparation
panel = Panel("g_material")
glassmod = HBGlassModifier(name=panel, trans="0.55")  # -> modifier; plug-in component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
brep = Brep([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])
aperture = HBAperture(geo=brep, rad_mod=glassmod)  # -> report, apertures; plug-in component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
addsubface = HBAddSubface(hb_obj=flatten(roomsolid.rooms), sub_faces=flatten(aperture.apertures))  # -> report, hb_obj, unmatched; plug-in component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
bordershades = HBExtrudedBorderShades(hb_objs=flatten(addsubface.hb_obj), depth="0.3")  # -> report, hb_objs; plug-in component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

# ---- group: Context!
brep_2 = Brep([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])
shade = HBShade(geo=brep_2)  # -> report, shades; plug-in component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

# ----
# Wea
panel_2 = Panel("https://energyplus-weather.s3.amazonaws.com/north_and_central_america_wmo_region_4/USA/MA/USA_MA_Boston-Logan.Intl.AP.725090_TMY3/USA_MA_Boston-Logan.Intl.AP.725090_TMY3.zip")
downloadepw = LBDownloadWeather(weather_URL=panel_2)  # -> epw_file, stat_file, ddy_file; plug-in component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
wea = HBWeaFromEPW(epw_file=downloadepw.epw_file)  # -> wea; plug-in component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

# ----
# Model + Grids
panel_3 = Panel("sample_model_grid")
model = HBModel(rooms=flatten(bordershades.hb_objs), shades=flatten(shade.shades), name=panel_3)  # -> report, model; plug-in component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
gridrooms = HBSensorGridFromRooms(rooms=bordershades.hb_objs, grid_size="0.5")  # -> grid, points, mesh; plug-in component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
assigngridsviews = HBAssignGridsAndViews(model=model.model, grids=flatten(gridrooms.grid))  # -> model; plug-in component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
vizwiref = HBVisualizeWireframe(hb_objs=flatten(model.model))  # -> geo; plug-in component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

# ----
# Run Recipe
toggle = BooleanToggle(False)
annualdaylight = HBAnnualDaylight(model=assigngridsviews, wea=wea, enhanced=toggle, run=Toggle(False))  # -> report, results, DA, cDA, UDI, UDI_low, UDI_up; plug-in component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

# ----
# Compute sDA
sda = HBSpatialDaylightAutonomy(DA=annualdaylight.DA)  # -> report, sDA, pass_fail; plug-in component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
sda_in_each_room = Panel(sda.sDA)

# ----
# Visualize Daylight Autonomy
mjoin = MeshJoin(Meshes=gridrooms.mesh)
data = Data(flatten(annualdaylight.DA))
heatmap = LBSpatialHeatmap(values=data, mesh=mjoin, legend_title="%")  # -> mesh, legend, title, colors, legend_par, vis_set; plug-in component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

legendpar = LBLegendParameters(num_decimals="0")  # -> leg_par; plug-in component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

# ----
# Visualize Hourly
# Illuminance for
# a Sensor
panel_4 = Panel("60")
pt = Point(gridrooms.points)
data_2 = Data(annualdaylight.results)
bang = ExplodeTree(Data=pt)  # -> Branch0, Branch1
item = ListItem(List=bang.Branch0, Index=panel_4, Wrap=True)
sph = Sphere(Base=item, Radius="0.5")
annualtodata = HBAnnualResultsToData(results=flatten(data_2), sel_pts=flatten(item), all_pts=pt)  # -> report, data; plug-in component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
hourlyplot = LBHourlyPlot(data=annualtodata.data, base_pt="50,0,0", legend_par=legendpar)  # -> report, mesh, legend, borders, labels, title, vis_set; plug-in component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
